# Grasshopper definition Horizontal_slicing_geometry_gh_file.gh (Grasshopper 1.0.6)

# ---- group: Input geo
geometry = Geometry(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)

# ---- group: Size
number_slider = Slider(1.53, range=0..10)

# ----
contour = Contour(Shape=geometry, Point=Point(0, 0, 0), Direction=Vector(0, 0, 1), Distance=number_slider)
unit_z = UnitZ(Factor=number_slider)
# Created by Benson AD
# Under CC-Resources Licence
# Visit CC- Resources for ore
surface = Surface(contour)

# ---- group: Result
extrude = Extrude(Base=surface, Direction=unit_z)
