# Grasshopper definition triangular_wood_slicing_canopy_bensonad_ccresources_gh_file.gh (Grasshopper 1.0.6)
# plug-ins: LunchBox

# ---- group: Input surface
surface = Surface(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)

# ---- group: Divisions
number_slider = Slider(50, range=0..100)

# ---- group: Extrusion Size
number_slider_2 = Slider(0.3, range=0..1)

# ---- group: Process
bounding_box = BoundingBox(Content=surface, Plane=PlaneXY(0, 0, 0))  # -> Box, Box_2
deconstruct_brep = DeconstructBrep(Brep=bounding_box.Box)  # -> Faces, Edges, Vertices
list_item = ListItem(List=deconstruct_brep.Faces, Index=4, Wrap=True)
triangle_panels_b = TrianglePanelsB(Surface=list_item, UDivisions=number_slider, VDivisions=number_slider)
deconstruct_brep_2 = DeconstructBrep(Brep=triangle_panels_b)  # -> Faces, Edges, Vertices
value_list = ValueList({"One": 1, "Two": 2, "Three": 2² - 1, "Four": Sqrt(16)}, selected="One")
value_list_2 = ValueList({"One": 1, "Two": 2, "Three": 2² - 1, "Four": Sqrt(16)}, selected="Two")
value_list_3 = ValueList({"One": 1, "Two": 2, "Three": 2² - 1, "Four": Sqrt(16)}, selected="Three")
list_item_2 = ListItem(List=deconstruct_brep_2.Edges, Index=value_list, Wrap=True)
list_item_3 = ListItem(List=deconstruct_brep_2.Edges, Index=value_list_2, Wrap=True)
list_item_4 = ListItem(List=deconstruct_brep_2.Edges, Index=value_list_3, Wrap=True)
join_curves = JoinCurves(Curves=list_item_2, Preserve=False)
join_curves_2 = JoinCurves(Curves=list_item_3, Preserve=False)
join_curves_3 = JoinCurves(Curves=list_item_4, Preserve=False)
# Created by Benson AD
# Under CC-Resources Licence
# Visit CC- Resources for ore
unit_z = UnitZ(Factor=number_slider_2)
project = Project(Curve=join_curves, Brep=surface, Direction=Vector(0, 0, 1))
project_2 = Project(Curve=join_curves_2, Brep=surface, Direction=Vector(0, 0, 1))
unit_z_2 = UnitZ(Factor=number_slider_2)
project_3 = Project(Curve=join_curves_3, Brep=surface, Direction=Vector(0, 0, 1))
unit_z_3 = UnitZ(Factor=expr("x*0.5", number_slider_2))
move = Move(Geometry=project_2, Motion=unit_z_2)  # -> Geometry, Transform
move_2 = Move(Geometry=project_3, Motion=unit_z_3)  # -> Geometry, Transform
merge = Merge(Data1=project, Data2=move.Geometry, Data3=move_2.Geometry)

# ---- group: Output geoemetry
extrude = Extrude(Base=merge, Direction=unit_z)
