# Grasshopper definition Waffle_geometry_gh_script.gh (Grasshopper 1.0.6)

# ---- group: input surface
surface = Surface(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)

# ---- group: Thickness
number_slider = Slider(4, range=0..10)

# ---- group: Distance between
number_slider_2 = Slider(3.59, range=0..10)

# ----
unit_z = UnitZ(Factor=number_slider)
extrude = Extrude(Base=surface, Direction=unit_z)
unit_x = UnitX(Factor=1)
unit_y = UnitY(Factor=1)
geometry = Geometry(extrude)
# Created by Benson AD
# Under CC-Resources Licence
# Visit CC- Resources for ore
contour = Contour(Shape=geometry, Point=Point(0, 0, 0), Direction=unit_x, Distance=number_slider_2)
contour_2 = Contour(Shape=geometry, Point=Point(0, 0, 0), Direction=unit_y, Distance=number_slider_2)
surface_2 = Surface(contour)
surface_3 = Surface(contour_2)

# ---- group: Output Geoetry
geometry_2 = Geometry([surface_2, surface_3])
