# Grasshopper definition cube_geometry_gh_file.gh (Grasshopper 1.0.6)

# ---- group: Input geometry
geometry = Geometry(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)

# ----
bounding_box = BoundingBox(Content=geometry, Plane=PlaneXY(0, 0, 0))  # -> Box, Box_2

# ---- group: resolution
number_slider = Slider(25, range=0..100)

# ----
deconstruct_brep = DeconstructBrep(Brep=bounding_box.Box)  # -> Faces, Edges, Vertices
list_item = ListItem(List=deconstruct_brep.Faces, Index=Slider(4, range=0..10), Wrap=True)
list_item_2 = ListItem(List=deconstruct_brep.Edges, Index=Slider(9, range=0..10), Wrap=True)
divide_surface = DivideSurface(Surface=list_item, UCount=number_slider, VCount=number_slider)  # -> Points, Normals, Parameters
length = Length(Curve=list_item_2)
division = Division(A=length, B=number_slider)
series = Series(Start=0, Step=division, Count=number_slider)
unit_z = UnitZ(Factor=series)
move = Move(Geometry=graft(divide_surface.Points), Motion=unit_z)  # -> Geometry, Transform
point_in_brep = PointInBrep(Brep=geometry, Point=move.Geometry, Strict=False)
cull_pattern = CullPattern(List=move.Geometry, CullPattern=point_in_brep)

# ---- group: Output geometry
center_box = CenterBox(Base=cull_pattern, X=division, Y=division, Z=division)
