# Grasshopper definition slicing_buildings.gh (Grasshopper 1.0.6)
# Copyright: Benson Architecture and Design

unit_z = UnitZ(Factor=1)

# ---- group: Input Surface
# Right click and
# set the surface
# for the skin facade
surface = Surface(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)

# ----
contour = Contour(Shape=surface, Point=Point(0, 0, 0), Direction=unit_z, Distance=Slider(8, range=0..10))

# ---- group: Output Slices
# Right click and
# Select bake to
# get the geometry
surface_2 = Surface(contour)
