# Grasshopper definition tower_massing.gh (Grasshopper 1.0.6)
# Copyright: Benson Architecture and Design

degree_of_scaling = Slider(0.4, range=0..1)

# ---- group: Second degree of scaling
number_slider = Slider(1, range=0..1)

# ---- group: Height of floor
number_slider_2 = Slider(10, range=0..10)

# ---- group: Degree of rotation
number_slider_3 = Slider(8, range=0..30)

# ---- group: Number of floors
number_slider_4 = Slider(19, range=0..100)

# ---- group: Buiding Outline(curve)
# Inputs
curve = Curve(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)

# ---- group: BUilding core curve
curve_2 = Curve(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)

# ----
series = Series(Start=0, Step=number_slider_2, Count=number_slider_4)
unit_z = UnitZ(Factor=series)
construct_domain = ConstructDomain(DomainStart=degree_of_scaling, DomainEnd=number_slider)
move = Move(Geometry=curve, Motion=unit_z)  # -> Geometry, Transform
series_2 = Series(Start=0, Step=number_slider_3, Count=number_slider_4)
area = Area(Geometry=move.Geometry)  # -> Area, Centroid
range = Range(Domain=construct_domain, Steps=number_slider_4)  # -> reverse(Range)
graph_mapper = GraphMapper(range, x0=0, x1=1, y0=0, y1=1, container_name="Bezier", cpx=[0, 0, 1, 1], cpy=[0, 0.6257607341, 0.3910469413, 1])
rotate = Rotate(Geometry=move.Geometry, Angle=degrees(series_2), Plane=area.Centroid)  # -> Geometry, Transform
polyline = PolyLine(Vertices=area.Centroid, Closed=False)
scale = Scale(Geometry=rotate.Geometry, Center=area.Centroid, Factor=graph_mapper)  # -> Geometry, Transform
sweep1 = Sweep1(Rail=polyline, Sections=curve_2, Miter=1)
loft = Loft(Curves=scale.Geometry, Options={Adjust=False, Closed=False, LoftEnds=0, LoftSimp=0, LoftType=0, Rebuild=10, Refit=0.01})
surface = Surface(scale.Geometry)

# ----
# Output (To bake)
custom_preview = CustomPreview(Geometry=surface, Material=ColourSwatch(SwatchColor=RGB(255, 255, 255)))
custom_preview_2 = CustomPreview(Geometry=loft, Material=ColourSwatch(SwatchColor=RGBA(158, 57, 133, 122)))
custom_preview_3 = CustomPreview(Geometry=sweep1, Material=ColourSwatch(SwatchColor=RGB(38, 38, 38)))
